% Simulink data dictionary ConfigData.sldd
% references CacheData.sldd

SoundSpeed = 300
CanaryCarrierFrequency = 20000
CanaryDataRate = 100
PreConvolveDownsample = 32
SampleRate = 48000
FmFrequencyDifferential = 400
FmDecoderFrameSize = 128
WalshCodeLength = 16
DataAmplitude = 0.5
CanaryAmplitude = 0.25
WalshCodeIndex = [9 3]